# Grasshopper definition insdol_gpu.gh (Grasshopper 1.0.7)
# plug-ins: LadybugGrasshopper, Weaverbird, Kangaroo2 Components, Human, Wombat

analysisperiod = LBAnalysisPeriod(start_month="9", start_day="21", start_hour="7", end_month="9", end_day="21", end_hour="21", timestep="1")  # -> period, hoys, dates; plug-in component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

constrloc = LBConstructLocation(latitude="51", elevation=0)  # -> location; plug-in component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

# ----
# env
brep = Brep(<brep referenced from the Rhino model>)
genpts = LBGeneratePointGrid(geometry=brep, grid_size="5")  # -> points, vectors, face_areas, mesh; plug-in component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

weaverbird_s_face_polylines = WeaverbirdsFacePolylines(Mesh=genpts.mesh)
explode = Explode(Curve=weaverbird_s_face_polylines, Recursive=True)  # -> Segments, Vertices
curve_middle = CurveMiddle(Curve=explode.Segments)  # -> flatten(Midpoint)
removeduplicatepts = RemoveDuplicatePts(Points=curve_middle, Tolerance=0.01)

# ----
# obj
brep_2 = Brep(<brep referenced from the Rhino model>)
genpts_2 = LBGeneratePointGrid(geometry=brep_2, grid_size="5")  # -> points, vectors, face_areas, mesh; plug-in component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

# ----
# tg = 2*offset / window_size
# angle = arctg(2*offset/ window_size )
panel = Panel("2")
# window_size
multiplication = Multiplication(A=panel, B="0.15")
division = Division(A=multiplication, B="1.2")
arctangent = ArcTangent(Value=division)

lb_falsestarttoggle = LBFalseStartToggle(True)

# ----
# env grid sgould be x2 more dense
weaverbird_s_vertices_component = WeaverbirdsVerticesComponent(MeshClosedPolylinesGroup=genpts.mesh, Weld=True)
merge = Merge(Data1=genpts.points, Data2=weaverbird_s_vertices_component, Data3=removeduplicatepts)  # -> flatten(Result)

average = Average(Input=flatten([genpts_2.points, merge]))
project = Project(Geometry=average, Plane=PlaneXY(0, 0, 0))  # -> Geometry, Transform

sunpath = LBSunPath(location=constrloc, hoys=analysisperiod.hoys, center_pt=project.Geometry, scale=1)  # -> out, vectors, altitudes, azimuths, hoys, sun_pts, analemma, daily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; plug-in component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
directsunhours = LBDirectSunHours(
    vectors=flatten(sunpath.vectors),
    timestep="1",
    geometry=flatten(brep_2),
    context=flatten(brep),
    grid_size="5",
    offset_dist="0.15",
    run=lb_falsestarttoggle)  # -> out, points, results, mesh, legend, title, int_mtx; plug-in component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
weaverbird_s_face_polylines_2 = WeaverbirdsFacePolylines(Mesh=directsunhours.mesh)

# ----
# sun vecs
# x
# normals
cross_reference = CrossReference(ListListA=sunpath.vectors, ListListB=genpts_2.vectors, CrossMode=1)  # -> ListListA, ListListB

# ----
# sun vecs
# x
# points
cross_reference_2 = CrossReference(ListListA=sunpath.vectors, ListListB=genpts_2.points, CrossMode=1)  # -> ListListA, ListListB

# ----
# angle > 90deg means
# that the sun illuminates the surface
panel_2 = Panel("0.5")
angle = Angle(VectorA=cross_reference_2.ListListA, VectorB=cross_reference.ListListB)  # -> Angle, Reflex
pi = Pi(Factor=panel_2)
addition = Addition(A=pi, B=arctangent)
larger_than = LargerThan(FirstNumber=angle.Angle, SecondNumber=addition)  # -> flatten(LargerThan), OrEqualTo

list_indices = ListIndices(Data=cross_reference_2.ListListA)

dispatch_multiple = DispatchMultiple(
    DispatchPattern=larger_than.LargerThan,
    ListList0=cross_reference_2.ListListA,
    List0=cross_reference_2.ListListB,
    List1=cross_reference.ListListB,
    List2=list_indices)  # -> ListList0, List0, List1, List2
graft_tree = GraftTree(Tree=dispatch_multiple.List1, IncludeEmptyLists=True, IncludeNullItems=True)  # -> simplify(Tree)
graft_tree_2 = GraftTree(Tree=dispatch_multiple.List0, IncludeEmptyLists=True, IncludeNullItems=True)  # -> simplify(Tree)
graft_tree_3 = GraftTree(Tree=dispatch_multiple.ListList0, IncludeEmptyLists=True, IncludeNullItems=True)  # -> simplify(Tree)

# ----
# a*d + b*e + c*f = 0
# 
# a*d =  - (b*e + c*f )
# 
# d =  - (b*e + c*f ) / a
# X_basis - [d,e,f] = [b,-a,0]
cluster = Cluster_2(point=graft_tree)
ghpython_script = GhPythonScript(xyz=cluster)  # -> shift; inputs xyz: list
# ---------- ghpython_script: Python ----------
shift = 0

for i, (c1, c2) in enumerate(zip(xyz, xyz[1:])):
    if c1==0 and c2==0:
        shift += 1
    elif c1==0 and c2!=0:
        shift += 1
        break
    else:
        break
# ---------- end ghpython_script ----------
shift_list = ShiftList(List=cluster, Shift=ghpython_script, Wrap=True)  # -> simplify(List)
tree_statistics = TreeStatistics(Tree=shift_list)  # -> Paths, Length, Count
list_item = ListItem(List=shift_list, Index=0, Wrap=True)  # -> Item, Item1, Item2
negative = Negative(Value=list_item.Item)
repeat_data = RepeatData(Data="0", Length=tree_statistics.Count)  # -> simplify(graft(Data))
negative_2 = Negative(Value=ghpython_script)
merge_2 = Merge(Data1=list_item.Item1, Data2=negative, Data3=repeat_data)
shift_list_2 = ShiftList(List=merge_2, Shift=negative_2, Wrap=True)  # -> simplify(List)
list_item_2 = ListItem(List=shift_list_2, Index=0, Wrap=True)  # -> Item, Item1, Item2
construct_point = ConstructPoint(XCoordinate=list_item_2.Item, YCoordinate=list_item_2.Item1, ZCoordinate=list_item_2.Item2)

# ----
# Y_axis = [a,b,c] x [d,e,f] = [ b*f - c*e, c*d - a*f, a*e - b*d ]
deconstruct = Deconstruct(Point=graft_tree)  # -> XComponent, YComponent, ZComponent
deconstruct_2 = Deconstruct(Point=construct_point)  # -> XComponent, YComponent, ZComponent
multiplication_2 = Multiplication(A=deconstruct.YComponent, B=deconstruct_2.ZComponent)
multiplication_3 = Multiplication(A=deconstruct.ZComponent, B=deconstruct_2.YComponent)
multiplication_4 = Multiplication(A=deconstruct.XComponent, B=deconstruct_2.ZComponent)
multiplication_5 = Multiplication(A=deconstruct.ZComponent, B=deconstruct_2.XComponent)
multiplication_6 = Multiplication(A=deconstruct.XComponent, B=deconstruct_2.YComponent)
multiplication_7 = Multiplication(A=deconstruct.YComponent, B=deconstruct_2.XComponent)
subtraction = Subtraction(A=multiplication_6, B=multiplication_7)
subtraction_2 = Subtraction(A=multiplication_2, B=multiplication_3)
subtraction_3 = Subtraction(A=multiplication_5, B=multiplication_4)
construct_point_2 = ConstructPoint(XCoordinate=subtraction_2, YCoordinate=subtraction_3, ZCoordinate=subtraction)

# ----
# sun vec
unit_vector = UnitVector(Vector=graft_tree_3)

construct_plane = ConstructPlane(Origin=graft_tree_2, XAxis=construct_point, YAxis=construct_point_2)
deconstruct_plane = DeconstructPlane(Plane=construct_plane)  # -> Origin, XAxis, YAxis, ZAxis
cluster_2 = Cluster_2(point=deconstruct_plane.ZAxis)
cluster_3 = Cluster_2(point=deconstruct_plane.XAxis)
cluster_4 = Cluster_2(point=deconstruct_plane.YAxis)
merge_3 = Merge(Data1=cluster_3, Data2=cluster_4, Data3=cluster_2)
construct_matrix = ConstructMatrix(Rows=3, Columns=3, Values=merge_3)

# ----
# create normal plane
plane_normal = PlaneNormal(Origin=graft_tree_2, ZAxis=graft_tree)  # -> simplify(Plane)

ghpython_script_2 = GhPythonScript(
    path="C:\Users\Admin\Desktop\insol_gpu",
    grid_size="5",
    window_offset="0.15",
    window_size="1.2",
    env_points=merge,
    obj_points=genpts_2.points,
    obj_normals=genpts_2.vectors,
    sun_vecs=sunpath.vectors)  # -> out, a; inputs env_points: list of Point3d, obj_points: list of Point3d, obj_normals: list of Point3d, sun_vecs: list of Point3d
# ---------- ghpython_script_2: Python ----------
import pickle
import os

out_dict = {}
out_dict["grid_size"] = grid_size
out_dict["window_offset"] = window_offset
out_dict["window_size"] = window_size

out_dict["env_points"] = [list(pt) for pt in env_points]
out_dict["obj_points"] = [list(pt) for pt in obj_points]
out_dict["obj_normals"] = [list(pt) for pt in obj_normals]
out_dict["sun_vecs"] = [list(sun_vec) for sun_vec in sun_vecs]

with open(os.path.join(path, 'data.pkl'), 'wb') as handle:
    pickle.dump(out_dict, handle, protocol=pickle.HIGHEST_PROTOCOL)
# ---------- end ghpython_script_2 ----------

# ----
# basis changed
#  motion
transform = Transform(Geometry=graft_tree_2, Transform=construct_matrix)

# ----
# no translation
transform_2 = Transform(Geometry=merge, Transform=construct_matrix)  # -> simplify(Geometry)

# ----
# translated
negative_3 = Negative(Value=transform)
cluster_5 = Cluster_4(point=negative_3)
transform_3 = Transform(Geometry=transform_2, Transform=cluster_5)

multiplication_8 = Multiplication(A="5", B=2)
# replace points that are "behind the back"
# with points, which will be guaranteed
# fra from calc.point
construct_point_3 = ConstructPoint(XCoordinate=multiplication_8, YCoordinate=multiplication_8, ZCoordinate=0)
list_length = ListLength(List=flatten(transform_3))
repeat_data_2 = RepeatData(Data=construct_point_3, Length=list_length)
unflatten_tree = UnflattenTree(Tree=repeat_data_2, Guide=transform_3)

deconstruct_3 = Deconstruct(Point=transform_3)  # -> XComponent, YComponent, ZComponent
smaller_than = SmallerThan(FirstNumber=deconstruct_3.ZComponent, SecondNumber=0)  # -> SmallerThan, OrEqualTo
pick_n_choose = PickNChoose(Pattern=smaller_than.SmallerThan, Stream0=transform_3, Stream1=unflatten_tree)

# ----
# basis change
# no translation
deconstruct_plane_2 = DeconstructPlane(Plane=construct_plane)  # -> Origin, XAxis, YAxis, ZAxis; disabled
construct_plane_2 = ConstructPlane(Origin=Point(0, 0, 0), XAxis=deconstruct_plane_2.XAxis, YAxis=deconstruct_plane_2.YAxis)  # disabled
xy_plane = XYPlane(Origin=Point(0, 0, 0))  # disabled
orient = Orient(Geometry=merge, Source=construct_plane_2, Target=xy_plane)  # -> Geometry, Transform; disabled

point = Point(unit_vector)

# ----
# sun direction
transform_4 = Transform(Geometry=point, Transform=construct_matrix)

dot_display = DotDisplay(Point=merge, Colour=RGB(0, 0, 0), Size=1)  # disabled

# ----
# project onto changed
# basis
cluster_6 = Cluster(vector=transform_4)
transform_5 = Transform(Geometry=pick_n_choose, Transform=cluster_6)

# ----
# basis change
# translated motion
orient_2 = Orient(Geometry=deconstruct_plane_2.Origin, Source=construct_plane_2, Target=xy_plane)  # -> Geometry, Transform; disabled

deconstruct_4 = Deconstruct(Point=transform_5)  # -> XComponent, YComponent, ZComponent
division_2 = Division(A="5", B=2)
absolute = Absolute(Value=deconstruct_4.YComponent)
absolute_2 = Absolute(Value=deconstruct_4.XComponent)
smaller_than_2 = SmallerThan(FirstNumber=absolute_2, SecondNumber=division_2)  # -> SmallerThan, OrEqualTo
smaller_than_3 = SmallerThan(FirstNumber=absolute, SecondNumber=division_2)  # -> SmallerThan, OrEqualTo
multiplication_9 = Multiplication(A=smaller_than_2.SmallerThan, B=smaller_than_3.SmallerThan)
mass_addition = MassAddition(Input=multiplication_9)  # -> Result, PartialResults

# ----
# basis chage
# translated
reverse = Reverse(Vector=orient_2.Geometry)  # disabled
move = Move(Geometry=orient.Geometry, Motion=reverse)  # -> Geometry, Transform; disabled

# ----
# basis change
# translated
orient_3 = Orient(Geometry=merge, Source=construct_plane, Target=xy_plane)  # -> Geometry, Transform; disabled

# ----
# cancel
# translation
cluster_7 = Cluster_4(point=transform)
transform_6 = Transform(Geometry=transform_5, Transform=cluster_7)

panel_3 = Panel("""sun1
sun2
sun3""")
panel_4 = Panel("""planeA
planeB""")
cross_reference_3 = CrossReference(ListListA=panel_3, ListListB=panel_4, CrossMode=1)  # -> simplify(graft(ListListA)), simplify(graft(ListListB))
concatenate = Concatenate(Fragment_A=cross_reference_3.ListListA, Fragment_B=" vs ", A=cross_reference_3.ListListB)
panel_5 = Panel(concatenate)

# ----
# basis change
# sun vector
# (no need to translate)
orient_4 = Orient(Geometry=unit_vector, Source=construct_plane_2, Target=xy_plane)  # -> Geometry, Transform; disabled

vector = Vector(orient_4.Geometry)  # disabled

# ----
# project onto changed
# basis
xy_plane_2 = XYPlane(Origin=Point(0, 0, 0))  # disabled
project_along = ProjectAlong(Geometry=move.Geometry, Plane=xy_plane_2, Direction=vector)  # -> Geometry, Transform; disabled

# ----
# orient back
# to world
transpose_matrix = TransposeMatrix(Matrix=construct_matrix)
transform_7 = Transform(Geometry=transform_6, Transform=transpose_matrix)

# ----
# "0" means 0 points,
# whichi are occluding
# this area
equality = Equality(FirstNumber=mass_addition.Result, SecondNumber=0)  # -> Equality, Inequality

# ----
# change basis back
orient_5 = Orient(Geometry=project_along.Geometry, Source=xy_plane_2, Target=construct_plane)  # -> Geometry, Transform; disabled

# ----
# what i wanna get
project_along_2 = ProjectAlong(Geometry=merge, Plane=construct_plane, Direction=unit_vector)  # -> Geometry, Transform; disabled

number_slider = Slider(6, range=0..10)  # disabled
construct_path = ConstructPath(Indices=number_slider)  # disabled
tree_branch = TreeBranch(Tree=transform_5, Path=construct_path, MaintainPaths=True)  # disabled
tree_branch_2 = TreeBranch(Tree=transform_7, Path=construct_path, MaintainPaths=True)  # disabled
heatmap = LBSpatialHeatmap(values=directsunhours.results, mesh=genpts_2.mesh)  # -> mesh, legend, title, colors, legend_par, vis_set; plug-in component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
line = Line(StartPoint=tree_branch_2, EndPoint=merge)  # disabled
panel_6 = Panel(directsunhours.results)

list_length_2 = ListLength(List=list_indices)
repeat_data_3 = RepeatData(Data="0", Length=list_length_2)

# ----
# plane score
list_length_3 = ListLength(List=sunpath.vectors)
flatten_tree = FlattenTree(Tree=equality.Equality, Path="{0}")

integer = Integer(flatten_tree)
replace_items = ReplaceItems(List=repeat_data_3, Item=integer, Indices=dispatch_multiple.List2, Wrap=False)

partition_list = PartitionList(List=replace_items, Size=list_length_3)  # -> simplify(Chunks)

mass_addition_2 = MassAddition(Input=partition_list)  # -> flatten(Result), PartialResults
heatmap_2 = LBSpatialHeatmap(values=mass_addition_2.Result, mesh=genpts_2.mesh)  # -> mesh, legend, title, colors, legend_par, vis_set; plug-in component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

# ==== cluster Cluster
vector = ClusterInput()
deconstruct_vector = DeconstructVector(Vector=vector)  # -> XComponent, YComponent, ZComponent
negative = Negative(Value=deconstruct_vector.ZComponent)
construct_matrix = ConstructMatrix(Rows=4, Columns=4)
division = Division(A=deconstruct_vector.YComponent, B=negative)
division_2 = Division(A=deconstruct_vector.XComponent, B=negative)
tree_statistics = TreeStatistics(Tree=division_2)  # -> Paths, Length, Count
repeat_data = RepeatData(Data=construct_matrix, Length=tree_statistics.Count)  # -> simplify(graft(Data))
repeat_data_2 = RepeatData(Data="0", Length=tree_statistics.Count)  # -> simplify(graft(Data))
deconstruct_matrix = DeconstructMatrix(Matrix=repeat_data)  # -> Rows, Columns, simplify(Values)
merge = Merge(Data1=division_2, Data2=division, Data3=repeat_data_2)
panel = Panel("""8
9
10""")
replace_items = ReplaceItems(List=deconstruct_matrix.Values, Item=merge, Indices=panel, Wrap=False)  # -> simplify(List)
construct_matrix_2 = ConstructMatrix(Rows=4, Columns=4, Values=replace_items)
transpose_matrix = TransposeMatrix(Matrix=construct_matrix_2)
list_item = ListItem(List=flatten(transpose_matrix), Index=0, Wrap=True)
display_matrix = DisplayMatrix(list_item)
matrix = ClusterOutput(transpose_matrix)

# ==== cluster Cluster_2
point = ClusterInput()
deconstruct = Deconstruct(Point=point)  # -> XComponent, YComponent, ZComponent
merge = Merge(Data1=deconstruct.XComponent, Data2=deconstruct.YComponent, Data3=deconstruct.ZComponent)
result = ClusterOutput(merge)

# ==== cluster Cluster_4
point = ClusterInput()
tree_statistics = TreeStatistics(Tree=point)  # -> Paths, Length, Count
deconstruct = Deconstruct(Point=point)  # -> XComponent, YComponent, ZComponent
repeat_data = RepeatData(Data="1", Length=tree_statistics.Count)  # -> simplify(graft(Data))
panel = Panel("""0
1
0
0""")
panel_2 = Panel("""1
0
0
0""")
panel_3 = Panel("""0
0
1
0""")
merge = Merge(Data1=deconstruct.XComponent, Data2=deconstruct.YComponent, Data3=deconstruct.ZComponent, Data4=repeat_data)
cluster = Cluster_3(relay=panel_3, number=tree_statistics.Count)
cluster_2 = Cluster_3(relay=panel_2, number=tree_statistics.Count)
cluster_3 = Cluster_3(relay=panel, number=tree_statistics.Count)
merge_2 = Merge(Data1=cluster_2, Data2=cluster_3, Data3=cluster, Data4=merge)
number_slider = Slider(4, range=0..10)
construct_matrix = ConstructMatrix(Rows=4, Columns=4, Values=merge_2)
list_item = ListItem(List=flatten(point), Index=number_slider, Wrap=True)
transpose_matrix = TransposeMatrix(Matrix=construct_matrix)
list_item_2 = ListItem(List=flatten(transpose_matrix), Index=number_slider, Wrap=True)
panel_4 = Panel(list_item)
display_matrix = DisplayMatrix(list_item_2)
matrix = ClusterOutput(transpose_matrix)

# ==== cluster Cluster_3
relay = ClusterInput()
number = ClusterInput()
duplicate_data = DuplicateData(Data=relay, Number=number, Order=True)
list_length = ListLength(List=relay)
partition_list = PartitionList(List=duplicate_data, Size=list_length)  # -> simplify(Chunks)
chunks = ClusterOutput(partition_list)
